# Grasshopper definition Grasshopper Code.gh (Grasshopper 1.0.7)
# plug-ins: Pufferfish, ItemSelector, dfenvimet

dfreadlibrary = DFEnvimetReadLibrary(_selectMaterial="GREENING")  # -> GreeningId, Description, XML
dfreadlibrary_2 = DFEnvimetReadLibrary(_selectMaterial="wall", SearchMaterial_="Aluminium ")  # -> WallMaterialOrRoofMaterial, Description, XML
mesh = Mesh(<mesh referenced from the Rhino model>)
mesh_2 = Mesh(<mesh referenced from the Rhino model>)
mesh_3 = Mesh(<mesh referenced from the Rhino model>)
mesh_4 = Mesh(<mesh referenced from the Rhino model>)
dfreadlibrary_3 = DFEnvimetReadLibrary(_selectMaterial="wall", SearchMaterial_="Concrete")  # -> WallMaterialOrRoofMaterial, Description, XML
dfreadlibrary_4 = DFEnvimetReadLibrary(_selectMaterial="wall", SearchMaterial_="Brick")  # -> WallMaterialOrRoofMaterial, Description, XML
faceb = FaceBoundaries(Mesh=mesh)
mesh_5 = Mesh(<mesh referenced from the Rhino model>)
faceb_2 = FaceBoundaries(Mesh=mesh_2)
dfreadlibrary_5 = DFEnvimetReadLibrary(_selectMaterial="profile", SearchMaterial_="water")  # -> ProfileId, Description, XML
faceb_3 = FaceBoundaries(Mesh=mesh_4)
faceb_4 = FaceBoundaries(Mesh=mesh_3)
dfreadlibrary_6 = DFEnvimetReadLibrary(_selectMaterial="wall", SearchMaterial_="Glass")  # -> WallMaterialOrRoofMaterial, Description, XML
panel = Panel(dfreadlibrary.GreeningId)
mesh_6 = Mesh(<mesh referenced from the Rhino model>)
dfreadlibrary_7 = DFEnvimetReadLibrary(_selectMaterial="profile", SearchMaterial_="Road")  # -> ProfileId, Description, XML
faceb_5 = FaceBoundaries(Mesh=mesh_5)
panel_2 = Panel(dfreadlibrary_2.WallMaterialOrRoofMaterial)
faceb_6 = FaceBoundaries(Mesh=mesh_6)
boundary = BoundarySurfaces(Edges=faceb)
boundary_2 = BoundarySurfaces(Edges=faceb_2)
boundary_3 = BoundarySurfaces(Edges=faceb_3)
join = BrepJoin(Breps=faceb_4)  # -> Breps, Closed
boundary_4 = BoundarySurfaces(Edges=faceb_5)
boundary_5 = BoundarySurfaces(Edges=faceb_6)
join_2 = BrepJoin(Breps=boundary)  # -> Breps, Closed
join_3 = BrepJoin(Breps=boundary_2)  # -> Breps, Closed
join_4 = BrepJoin(Breps=boundary_3)  # -> Breps, Closed
list = Honeybee_ItemSelector(panel_2, {"0100AL", "0000AL"}, selected="0100AL")
panel_3 = Panel(dfreadlibrary_5.ProfileId)
panel_4 = Panel(dfreadlibrary_3.WallMaterialOrRoofMaterial)
join_5 = BrepJoin(Breps=boundary_4)  # -> Breps, Closed
panel_5 = Panel(dfreadlibrary_7.ProfileId)
list_2 = Honeybee_ItemSelector(panel, {"01NAFG", "01NASS", "01NADS", "01AGSS", "01AGDS"}, selected="01NADS")
panel_6 = Panel(dfreadlibrary_4.WallMaterialOrRoofMaterial)
brep = Brep(join.Breps)
join_6 = BrepJoin(Breps=boundary_5)  # -> Breps, Closed
panel_7 = Panel(dfreadlibrary_6.WallMaterialOrRoofMaterial)
brep_2 = Brep(join_2.Breps)
brep_3 = Brep(join_3.Breps)
brep_4 = Brep(join_4.Breps)
geo = Geometry(brep)
brep_5 = Brep(<brep referenced from the Rhino model>)
brep_6 = Brep(join_5.Breps)
list_3 = Honeybee_ItemSelector(
    panel_4,
    {"0100PC", "0100C1", "0100C2", "0100C3", "0100C4", "0100C5", "0000CS", "0000PC", "0000C1", "0000C2", "0000C3", "0000C4", "0000C5", "0000CS"}, selected="0100PC")
geo_2 = Geometry(brep_2)
brep_7 = Brep(join_6.Breps)
geo_3 = Geometry(brep_3)
list_4 = Honeybee_ItemSelector(panel_6, {"0100G5", "0100B1", "0100B2", "0100B3", "0000G5", "0000B1", "0000B2", "0000B3"}, selected="0100B2")
geo_4 = Geometry(brep_4)
list_5 = Honeybee_ItemSelector(panel_3, {"0000WW", "0100WW"}, selected="0000WW")
list_6 = Honeybee_ItemSelector(
    panel_7,
    {"0100G1", "0100G2", "0100G3", "0100G4", "0100G5", "0100GH", "0100SG", "0000G1", "0000G2", "0000G3", "0000G4", "0000G5", "0000GH", "0000SG"}, selected="0100GH")
list_7 = Honeybee_ItemSelector(
    panel_5,
    {"0000ST", "0100ST", "0000KK", "0100KK", "0000KG", "0100KG", "0000AR", "0100AR", "0000BA", "0100BA"}, selected="0100KG")
geo_5 = Geometry(brep_6)
geo_6 = Geometry(brep_7)
dfenvimet3dplant = DFEnvimet3dPlant(_plant3D=geo_3)
dfenvimetbuildings = DFEnvimetBuildings(_geometry=geo_2, WallMaterial_=list_3, SimplifiedCalculation_=False)
dfenvimetbuildings_2 = DFEnvimetBuildings(_geometry=brep_5, WallMaterial_=list, GreenWallMaterial_=list_2, SimplifiedCalculation_=False)
dfenvimetbuildings_3 = DFEnvimetBuildings(_geometry=geo_4, WallMaterial_=list_4, SimplifiedCalculation_=False)
dfenvimetsoil = DFEnvimetSoil(_soil=geo_5, _profileId_=list_5)
dfenvimetbuildings_4 = DFEnvimetBuildings(_geometry=geo, WallMaterial_=list_6, SimplifiedCalculation_=False)
dfenvimetsoil_2 = DFEnvimetSoil(_soil=geo_6, _profileId_=list_7)

panel_8 = Panel("Objects from Rhino")
ladybug = Ladybug_Ladybug()  # -> Vviiiiiiiiiizzz; plug-in component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
honeybee = Honeybee_Honeybee()  # -> Vviiiiiiiiiizzz; plug-in component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

# ----
# Location of the Project
constructlocation = Ladybug_ConstructLocation(locationName="DEventer", latitude="52.26", longitude="6.15", timeZone=0, elevation=0)  # -> location; plug-in component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
dfenvimetlocation = DFEnvimetLocation(_location=constructlocation, ModelRotation_="-45", ReferenceLongitude_=15)

number_slider = Slider(4, range=0..50)

panel_9 = Panel("final everything9with green facade")
dfenvimetmanageworkspace = DFEnvimetManageWorkspace(_workspaceFolder="E:\Thesis\Envi-met\start test", _projectName_=panel_9)
srf = Surface(<surface referenced from the Rhino model>)
dfenvimetgrid = DFEnvimetGrid(
    _baseSurface=srf,
    StartTelescopeHeight_=5,
    DimX_=number_slider,
    DimY_=number_slider,
    DimZ_=number_slider,
    AddCellsLeft_=2,
    AddCellslRight_=2,
    AddCellsUp_=2,
    AddCellsDown_=2,
    NumCellsZ_=Slider(30, range=0..100),
    CombineGridType_=False)
dfenvimetspaces = DFEnvimetSpaces(
    _envimetFolder=dfenvimetmanageworkspace,
    _envimetLocation=dfenvimetlocation,
    _envimentGrid=dfenvimetgrid,
    _envimentObjects_=flatten([dfenvimetbuildings_3, dfenvimetsoil_2, dfenvimet3dplant, dfenvimetbuildings_2, dfenvimetbuildings_4]),
    FileName_=panel_9,
    _runIt=Toggle(False),
    ViewGrid_=Toggle(True))  # -> ModelInfo, XYGrid, XZGrid, YZGrid, INXfileAddress
dfenvimetruninx = DFEnvimetRunINX(_INXfileAddress=dfenvimetspaces.INXfileAddress, _runIt=Toggle(True))

number_slider_2 = Slider(1.3, range=0..2.2)
mesh_7 = Mesh(<mesh referenced from the Rhino model>)
offmsh = OffsetMesh(Mesh=mesh_7, Distance=number_slider_2, BothSides=number_slider_2, CreateSolid=True)
crv = Curve(<curve referenced from the Rhino model>)
dfeditbuildingmaterials = DFEditBuildingMaterials(
    _INXfileAddress=dfenvimetspaces.INXfileAddress,
    _envimentGrid=dfenvimetgrid,
    _selectorCurve=crv,
    SelectorShape_=offmsh,
    MaterialX_="000G4",
    MaterialY_="000G4",
    _runIt=Toggle(True))

panel_10 = Panel("Adding windows layers")
panel_11 = Panel("Envi-met Settings")

# ----
# Adding weather data (EPW)
downloadepw = Ladybug_downloadEPWWeatherFile(download=Toggle(False))  # -> readMe; plug-in component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
panel_12 = Panel("https://www.energyplus.net/weather-download/europe_wmo_region_6/NLD//NLD_Amsterdam.062400_IWEC/all")
epw_stat = Ladybug_OpenEPWAndSTATWeatherFiles(weatherFileURL=panel_12)  # -> epwFile, statFile; plug-in component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
doy_hoy = Ladybug_DOY_HOY(days=Slider(8, range=0..31), months=Slider(8, range=0..12), hours=Slider(8, range=0..24))  # -> HOY, DOY, date; plug-in component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

dfenvimetsimpleforcebyepw = DFEnvimetSimpleForceByEPW(epwFile=epw_stat.epwFile, HOY=doy_hoy.HOY, DOY=doy_hoy.DOY)  # -> readMe, dryBulbTemperature, relativeHumidity, startDate, startTime; plug-in component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
dfenvimetconfigsimpleforcing = DFEnvimetConfigSimpleForcing(_dryBulbTemperature=dfenvimetsimpleforcebyepw.dryBulbTemperature)
dfenvimetconfigmainsettings = DFEnvimetConfigMainSettings(
    _simName=panel_9,
    _INXfileAddress=dfenvimetspaces.INXfileAddress,
    StartDate_=dfenvimetsimpleforcebyepw.startDate,
    StartTime_=dfenvimetsimpleforcebyepw.startTime,
    SimDuration_=Slider(8, range=0..50),
    WindSpeed_=3,
    WindDirection_=0,
    Roughness_=0.01,
    InitialTemperature_=dfenvimetsimpleforcebyepw.dryBulbTemperature,
    SpecificHumidity_=7,
    RelativeHumidity_=dfenvimetsimpleforcebyepw.relativeHumidity)
dfenvimetfullforcingsettings = DFEnvimetFullForcingSettings(
    _epw=epw_stat.epwFile,
    _envimetFolder=dfenvimetmanageworkspace,
    _forceTemperature_=True,
    _forceWind_=True,
    _forceRelativeHumidity_=True,
    _forcePrecipitation_=False,
    _forceRadiationClouds_=True,
    MinFlowSteps_=50,
    LimitWind2500_=0,
    MaxWind2500_=20)
dfenvimetconfig = DFEnvimetConfig(_mainSettings=dfenvimetconfigmainsettings, OtherSettings_=dfenvimetfullforcingsettings, _runIt=Toggle(True))
dfenvimetrunsimulation = DFEnvimetRunSimulation(_envimetFolder=dfenvimetmanageworkspace, _SIMXfileAddress=dfenvimetconfig, _type_=True, _runIt=False)

panel_13 = Panel("Creating simulation file")
