# Dynamo graph Simplifying BIM .dyn "Marjan" (Dynamo 2.5.0.7460)
# packages: archi-lab.net 2021.25.2521

# group: Panels
categories = Categories("OST_GenericModel")
all_elements_of_category = ElementsOfCategory(Category=categories)
name = Element.Name(element=all_elements_of_category)
code_block = CodeBlock { "WB_41"; }
startsWith = String.StartsWith(str=name, searchFor=code_block)
filterByBoolMask = List.FilterByBoolMask(list=all_elements_of_category, mask=startsWith)
faces = Element.Faces(element=filterByBoolMask.in)
perimeter = Surface.Perimeter(surface=faces)
maximumItem = List.MaximumItem(list=perimeter@L2)
eq = perimeter@L2 == maximumItem  # lacing=Longest
filterByBoolMask_2 = List.FilterByBoolMask(list=faces, mask=eq)
flatten = List.Flatten(list=filterByBoolMask_2.in)

# group: Walls
categories_2 = Categories("OST_Walls")
all_elements_of_category_2 = ElementsOfCategory(Category=categories_2)
name_2 = Element.Name(element=all_elements_of_category_2)
code_block_2 = CodeBlock { "Metselwerk"; }
startsWith_2 = String.StartsWith(str=name_2, searchFor=code_block_2)
filterByBoolMask_3 = List.FilterByBoolMask(list=all_elements_of_category_2, mask=startsWith_2)
flatten_2 = List.Flatten(list=filterByBoolMask_3.in)
faces_2 = Element.Faces(element=flatten_2)
normalAtParameter = Surface.NormalAtParameter(surface=faces_2)
exteriorDirection = Custom[Wall.ExteriorDirection](wall=flatten_2)  # package archi-lab.net; This node returns exterior direction of the wall as a vector.
isAlmostEqualTo = Vector.IsAlmostEqualTo(vector=normalAtParameter, other=exteriorDirection)
filterByBoolMask_4 = List.FilterByBoolMask(list=faces_2, mask=isAlmostEqualTo)
flatten_3 = List.Flatten(list=filterByBoolMask_4.in)

# group: Curtainwall
categories_3 = Categories("OST_CurtainWallPanels")
all_elements_of_category_3 = ElementsOfCategory(Category=categories_3)
boundaries = CurtainPanel.Boundaries(curtainPanel=all_elements_of_category_3)
flatten_4 = List.Flatten(list=boundaries)
isNull = Object.IsNull(obj=flatten_4)
filterByBoolMask_5 = List.FilterByBoolMask(list=all_elements_of_category_3, mask=isNull)
boundaries_2 = CurtainPanel.Boundaries(curtainPanel=filterByBoolMask_5.out)
flatten_5 = List.Flatten(list=boundaries_2)
isNull_2 = Object.IsNull(obj=flatten_5)
filterByBoolMask_6 = List.FilterByBoolMask(list=flatten_5, mask=isNull_2)
byPatch = Surface.ByPatch(closedCurve=filterByBoolMask_6.out)

# group: Roofs
categories_4 = Categories("OST_Roofs")
all_elements_of_category_4 = ElementsOfCategory(Category=categories_4)
faces_3 = Element.Faces(element=all_elements_of_category_4)
normalAtParameter_2 = Surface.NormalAtParameter(surface=faces_3)
Z = Vector.Z(vector=normalAtParameter_2)
code_block_3 = CodeBlock { 0.95; }
gt = Z > code_block_3
filterByBoolMask_7 = List.FilterByBoolMask(list=faces_3, mask=gt)
flatten_6 = List.Flatten(list=filterByBoolMask_7.in)

# group: Windows
categories_5 = Categories("OST_Windows")
all_elements_of_category_5 = ElementsOfCategory(Category=categories_5)
name_3 = Element.Name(element=all_elements_of_category_5)
code_block_4 = CodeBlock { "vast"; }
startsWith_3 = String.StartsWith(str=name_3, searchFor=code_block_4)
filterByBoolMask_8 = List.FilterByBoolMask(list=all_elements_of_category_5, mask=startsWith_3)
flatten_7 = List.Flatten(list=filterByBoolMask_8.in)
facingOrientation = FamilyInstance.FacingOrientation(familyInstance=flatten_7)
code_block_5 = CodeBlock { ["Height", "Width"]; }
getParameterValueByName = Element.GetParameterValueByName(element=flatten_7, parameterName=code_block_5, lacing=CrossProduct)
transpose = List.Transpose(lists=getParameterValueByName)
code_block_6 = CodeBlock(par=transpose) { par[0]; par[1]; }

solids = Element.Solids(element=flatten_7)
centroid = Solid.Centroid(solid=solids)

# group (continued): Windows
byOriginNormal = Plane.ByOriginNormal(origin=centroid, normal=facingOrientation)
byWidthLength = Rectangle.ByWidthLength(plane=byOriginNormal, width=code_block_6.out0, length=code_block_6.out1)
isNull_3 = Object.IsNull(obj=byWidthLength)
filterByBoolMask_9 = List.FilterByBoolMask(list=byWidthLength, mask=isNull_3)
byPatch_2 = Surface.ByPatch(closedCurve=filterByBoolMask_9.out)

file_path = Filename(".\Panels.sat")
exportToSAT = ExportWithUnits(geometry=byPatch_2, filePath=file_path, SelectedExportedUnitsSource=[0, 1, 2, 3, 5, 4], SelectedExportedUnit=2)
